# Grasshopper definition 1.gh (Grasshopper 1.0.5)
# plug-ins: Barnacle

point = Point([Point(249, -96, 0), Point(178, -96, 0), Point(178, -31, 0), Point(235, -31, 0)])
list_item = ListItem(List=point, Index=0, Wrap=True)  # -> Item, Item1, Item2, Item3
polyline = PolyLine(Vertices=point, Closed=True)
boundaryparking = BoundaryParking(
    PointA=list_item.Item,
    PointB=list_item.Item1,
    PointC=list_item.Item2,
    PointD=list_item.Item3,
    TopIResult=Slider(0, range=0..100),
    GetData=Toggle(True))  # -> Result, Out
point_2 = Point(list_item.Item2)
geometry = Geometry(boundaryparking.Out)
list_length = ListLength(List=geometry)
series = Series(Start=0, Step=1, Count=list_length)
value_list = ValueList({"Zero": 0, "One": 1, "Two": 2, "Three": 2² - 1, "Four": Sqrt(16)}, selected="Zero")
list_item_2 = ListItem(List=geometry, Index=series, Wrap=True)  # -> Item1, Item
curve_curve = CurveCurve(CurveA=list_item_2.Item1, CurveB=list_item_2.Item)  # -> Points, ParamsA, ParamsB
geometry_2 = Geometry(curve_curve.Points)
list_item_3 = ListItem(List=flatten(geometry_2), Index=0, Wrap=True)  # -> Item1, Item, Item1_2, Item2, Item3
barnacle = Barnacle(
    PointA=list_item_3.Item,
    PointB=list_item_3.Item1_2,
    PointC=list_item_3.Item2,
    PointD=list_item_3.Item3,
    TopIResult=Slider(0, range=-1..1000000),
    GetData=Toggle(False))
patch = Patch(Spans=20, Flexibility=1, Trim=True)
curve_self = CurveSelf()  # -> Points, Params
boundary_surfaces = BoundarySurfaces()
list_item_4 = ListItem(Index=0, Wrap=True)
polygon = Polygon(Plane=PlaneXY(0, 0, 0), Radius=3, Segments=6, FilletRadius=0)  # -> Polygon, Length
edge_surface = EdgeSurface()
barnacle_2 = Barnacle()
