# Grasshopper definition test0510.gh (Grasshopper 1.0.5)
# plug-ins: Barnacle

point = Point([<point referenced from the Rhino model> x4])
point_2 = Point([Point(249, -96, 0), Point(153.7370322, -96, 0), Point(166.3520446, -20.50905132, 0), Point(235, 18.64852257, 0)])
# Original Points
point_3 = Point([Point(249, -96, 0), Point(178, -96, 0), Point(178, -31, 0), Point(235, -31, 0)])
point_4 = Point(point)
polyline = PolyLine(Vertices=point_4, Closed=True)
point_5 = Point()
explode = Explode(Curve=polyline, Recursive=True)  # -> Segments, Vertices
result_number = Slider(0, range=0..100000)
number_slider = Slider(4, range=0..10)
number_slider_2 = Slider(2, range=0..10)
number_slider_3 = Slider(3, range=0..10)
number_slider_4 = Slider(0, range=0..10)
number_slider_5 = Slider(0, range=0..10)
number_slider_6 = Slider(1, range=0..10)
boolean_toggle = BooleanToggle(False)
barnacle = Barnacle()  # -> Result, Measurement

# ----
# Row Solver
# Row Stall Count:
number_slider_7 = Slider(0, range=0..100)

# ----
# Boundary Solver
# Boundary Stall Count:
number_slider_8 = Slider(0, range=0..1000)

cluster = Cluster(list=point_4, top_i_result=number_slider_8, get_data=Button())  # -> result, out, stall_count

panel = Panel(cluster.stall_count)

geometry = Geometry(cluster.out)
cluster_2 = Cluster_2(geometry=geometry, i=number_slider_7, bool=Button())  # -> result, metric

panel_2 = Panel(cluster_2.metric)

geometry_2 = Geometry(cluster.result)
geometry_3 = Geometry(cluster_2.result)

# ==== cluster Cluster
list = ClusterInput()
list_item = ListItem(List=list, Index=0, Wrap=True)  # -> Item, Item1, Item2, Item3
top_i_result = ClusterInput()
get_data = ClusterInput()
boundaryparking = BoundaryParking(
    PointA=list_item.Item,
    PointB=list_item.Item1,
    PointC=list_item.Item2,
    PointD=list_item.Item3,
    TopIResult=top_i_result,
    GetData=get_data)  # -> Result, Out, StallCount
out = ClusterOutput(boundaryparking.Out)
stall_count = ClusterOutput(boundaryparking.StallCount)
result = ClusterOutput(boundaryparking.Result)

# ==== cluster Cluster_2
geometry = ClusterInput()
geometry_2 = Geometry(geometry)
list_length = ListLength(List=geometry_2)
series = Series(Start=0, Step=1, Count=list_length)
list_item = ListItem(List=geometry_2, Index=series, Wrap=True)  # -> Item1, Item
curve_curve = CurveCurve(CurveA=list_item.Item1, CurveB=list_item.Item)  # -> Points, ParamsA, ParamsB
i = ClusterInput()
bool = ClusterInput()
geometry_3 = Geometry(curve_curve.Points)
list_item_2 = ListItem(List=flatten(geometry_3), Index=0, Wrap=True)  # -> Item1, Item, Item1_2, Item2, Item3
barnacle = Barnacle(
    PointA=list_item_2.Item,
    PointB=list_item_2.Item1_2,
    PointC=list_item_2.Item2,
    PointD=list_item_2.Item3,
    TopIResult=i,
    GetData=bool)  # -> Result, Measurement
result = ClusterOutput(barnacle.Result)
metric = ClusterOutput(barnacle.Measurement)
